# Grasshopper definition udp_receiver.gh (Grasshopper 0.9.76)
# plug-ins: gHowl

timer = Timer(TimerInterval=20, Target=udp)
udp = UDPReceiver(Port="8888", Pattern=0)  # -> Info, Data
panel = Panel(udp.Data)
